# Grasshopper definition GenerateCase.gh (Grasshopper 1.0.7)
# plug-ins: Human

output_directory = Panel("C:\Users\tgerrish\Documents\GitHub\oshe\projects\FamilyPark")
weatherfile = Panel("C:\Users\tgerrish\Documents\GitHub\oshe\projects\FamilyPark\UWG_ARE_AZ_Abu.Dhabi-Bateen.Exec.AP.412160_TMYx_URBAN_02.epw")
material = Panel("""VEG_PALM
VeryRough
0.05
0.01
0.5
150
0.9
0.7
0.9""")
material_2 = Panel("""VEG_GHAF
VeryRough
0.05
0.01
0.5
150
0.9
0.7
0.9""")
material_3 = Panel("""GND_WATER
MediumRough
0.2
1.4
1840
1480
0.95
0.8
0""")
material_4 = Panel("""SHD_SOLID
MediumRough
0.102
0.12
320
795
0.9
0.7
0""")
material_5 = Panel("""GND_VEGETATION
Rough
0.2
1
1250
1252
0.92
0.75
0""")
material_6 = Panel("""GND_SURROUNDING
MediumRough
0.2
1.73
2243
837
0.9
0.65
0""")
material_7 = Panel("""SHD_P1_POROUS
MediumRough
0.102
0.12
320
795
0.9
0.7
0.15""")
material_8 = Panel("""SHD_P2_POROUS
MediumRough
0.102
0.12
320
795
0.9
0.7
0.15""")
material_9 = Panel("""GND_STONEDARK
MediumRough
0.2
2
2243
790
0.9
0.75
0""")
material_10 = Panel("""GND_ACTIVE
MediumRough
0.3
0.2
1250
1000
0.9
0.6
0""")
material_11 = Panel("""GND_ASPHALT
MediumRough
0.2
0.75
2360
920
0.93
0.87
0""")
material_12 = Panel("""GND_CONCRETE
MediumRough
0.2
1.73
2243
837
0.9
0.65
0""")
material_13 = Panel("""GND_STONE
MediumRough
0.2
2
2243
790
0.9
0.55
0""")
material_14 = Panel("""SHD_METAL
Smooth
0.0008
45.28
7824
500
0.9
0.7
0""")
material_15 = Panel("""GND_SAND
Rough
0.2
0.33
1555
800
0.85
0.65
0""")
material_16 = Panel("""GND_WOOD
MediumSmooth
0.1
0.15
608
1630
0.9
0.7
0""")
material_17 = Panel("""GND_PLAY
Rough
0.2
0.5
1600
1026
0.9
0.7
0""")
material_18 = Panel("""BDG_CONTEXT
MediumRough
0.2032
1.95
2240
900
0.9
0.7
0""")
material_19 = Panel("""GND_GRASS
Rough
0.2
1
1250
1252
0.92
0.75
0""")
refreshall = Button()
ladybug = Ladybug_Ladybug()  # -> Vviiiiiiiiiizzz; plug-in component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
honeybee = Honeybee_Honeybee()  # -> Vviiiiiiiiiizzz; plug-in component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
e_executable_path = Panel("C:\openstudio-2.7.0\EnergyPlus\energyplus.exe")
toplayer = Data("FAMILYPARK2")

# ---- group: GROUND SURFACES
python = GhPythonScript(Refresh=refreshall, MaterialPanel=material_16)  # -> LayerName, Roughness, Thickness, Conductivity, Density, SpecificHeat, ThermalAbsorptivity, SolarAbsorptivity, Porosity; inputs Refresh: Boolean, MaterialPanel: list
# ---------- python: Python ----------
if Refresh:
    pass

LayerName = str(MaterialPanel[0])
Roughness = str(MaterialPanel[1])
Thickness = float(MaterialPanel[2])
Conductivity = float(MaterialPanel[3])
Density = float(MaterialPanel[4])
SpecificHeat = float(MaterialPanel[5])
ThermalAbsorptivity = float(MaterialPanel[6])
SolarAbsorptivity = float(MaterialPanel[7])
Porosity = float(MaterialPanel[8])
# ---------- end python ----------
cluster = Cluster_3(solarabsorptivity=python.SolarAbsorptivity)
epopaquemat = Honeybee_EnergyPlusOpaqueMaterial(
    name=python.LayerName,
    roughness=python.Roughness,
    thickness=python.Thickness,
    conductivity=python.Conductivity,
    density=python.Density,
    specificHeat=python.SpecificHeat,
    thermAbsp=python.ThermalAbsorptivity,
    solAbsp=python.SolarAbsorptivity,
    visAbsp=python.SolarAbsorptivity)  # -> EPMaterial; plug-in component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
cluster_2 = Cluster(toplayer=toplayer, layername=python.LayerName)  # -> surfaces_2, surfacenames_2
radopaquemat = HoneybeePlus_RadianceOpaqueMaterial(name=graft(python.LayerName), reflect=graft(cluster), spec=0, rough=0)  # -> simplify(material); plug-in component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
epconstruction = Honeybee_EnergyPlusConstruction(name=python.LayerName, layer_1=epopaquemat)  # -> EPConstruction; plug-in component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
cluster_3 = Cluster_2(surfaces=cluster_2.surfaces_2)
createhbsrfs = Honeybee_createHBSrfs(geometry=cluster_2.surfaces_2, srfName=cluster_2.surfacenames_2, srfType="1", EPConstruction=epconstruction)  # -> readMe, simplify(flatten(HBSurface)); plug-in component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
hbsurface = HoneybeePlus_HoneybeeSurface(geo=cluster_2.surfaces_2, names=cluster_2.surfacenames_2, type="1", rad_mat=radopaquemat)  # -> report, flatten(HB_srf); plug-in component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
hbsrfs_energyplus = Data(createhbsrfs.HBSurface)
hb_srfs_radiance = Data(hbsurface.HB_srf)
boundaries = Data(flatten(cluster_3))
reflectivity = Data(cluster)

python_2 = GhPythonScript(Refresh=refreshall, MaterialPanel=material_13)  # -> LayerName, Roughness, Thickness, Conductivity, Density, SpecificHeat, ThermalAbsorptivity, SolarAbsorptivity, Porosity; inputs Refresh: Boolean, MaterialPanel: list; same code as python
cluster_4 = Cluster_3(solarabsorptivity=python_2.SolarAbsorptivity)
epopaquemat_2 = Honeybee_EnergyPlusOpaqueMaterial(
    name=python_2.LayerName,
    roughness=python_2.Roughness,
    thickness=python_2.Thickness,
    conductivity=python_2.Conductivity,
    density=python_2.Density,
    specificHeat=python_2.SpecificHeat,
    thermAbsp=python_2.ThermalAbsorptivity,
    solAbsp=python_2.SolarAbsorptivity,
    visAbsp=python_2.SolarAbsorptivity)  # -> EPMaterial; plug-in component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
cluster_5 = Cluster(toplayer=toplayer, layername=python_2.LayerName)  # -> surfaces_2, surfacenames_2
radopaquemat_2 = HoneybeePlus_RadianceOpaqueMaterial(name=graft(python_2.LayerName), reflect=graft(cluster_4), spec=0, rough=0)  # -> simplify(material); plug-in component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
epconstruction_2 = Honeybee_EnergyPlusConstruction(name=python_2.LayerName, layer_1=epopaquemat_2)  # -> EPConstruction; plug-in component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
cluster_6 = Cluster_2(surfaces=cluster_5.surfaces_2)
createhbsrfs_2 = Honeybee_createHBSrfs(geometry=cluster_5.surfaces_2, srfName=cluster_5.surfacenames_2, srfType="1", EPConstruction=epconstruction_2)  # -> readMe, simplify(flatten(HBSurface)); plug-in component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
hbsurface_2 = HoneybeePlus_HoneybeeSurface(geo=cluster_5.surfaces_2, names=cluster_5.surfacenames_2, type="1", rad_mat=radopaquemat_2)  # -> report, flatten(HB_srf); plug-in component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
hbsrfs_energyplus_2 = Data(createhbsrfs_2.HBSurface)
hb_srfs_radiance_2 = Data(hbsurface_2.HB_srf)
boundaries_2 = Data(flatten(cluster_6))
reflectivity_2 = Data(cluster_4)

python_3 = GhPythonScript(Refresh=refreshall, MaterialPanel=material_9)  # -> LayerName, Roughness, Thickness, Conductivity, Density, SpecificHeat, ThermalAbsorptivity, SolarAbsorptivity, Porosity; inputs Refresh: Boolean, MaterialPanel: list; same code as python
cluster_7 = Cluster_3(solarabsorptivity=python_3.SolarAbsorptivity)
epopaquemat_3 = Honeybee_EnergyPlusOpaqueMaterial(
    name=python_3.LayerName,
    roughness=python_3.Roughness,
    thickness=python_3.Thickness,
    conductivity=python_3.Conductivity,
    density=python_3.Density,
    specificHeat=python_3.SpecificHeat,
    thermAbsp=python_3.ThermalAbsorptivity,
    solAbsp=python_3.SolarAbsorptivity,
    visAbsp=python_3.SolarAbsorptivity)  # -> EPMaterial; plug-in component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
cluster_8 = Cluster(toplayer=toplayer, layername=python_3.LayerName)  # -> surfaces_2, surfacenames_2
radopaquemat_3 = HoneybeePlus_RadianceOpaqueMaterial(name=graft(python_3.LayerName), reflect=graft(cluster_7), spec=0, rough=0)  # -> simplify(material); plug-in component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
epconstruction_3 = Honeybee_EnergyPlusConstruction(name=python_3.LayerName, layer_1=epopaquemat_3)  # -> EPConstruction; plug-in component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
cluster_9 = Cluster_2(surfaces=cluster_8.surfaces_2)
createhbsrfs_3 = Honeybee_createHBSrfs(geometry=cluster_8.surfaces_2, srfName=cluster_8.surfacenames_2, srfType="1", EPConstruction=epconstruction_3)  # -> readMe, simplify(flatten(HBSurface)); plug-in component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
hbsurface_3 = HoneybeePlus_HoneybeeSurface(geo=cluster_8.surfaces_2, names=cluster_8.surfacenames_2, type="1", rad_mat=radopaquemat_3)  # -> report, flatten(HB_srf); plug-in component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
hbsrfs_energyplus_3 = Data(createhbsrfs_3.HBSurface)
hb_srfs_radiance_3 = Data(hbsurface_3.HB_srf)
reflectivity_3 = Data(cluster_7)
boundaries_3 = Data(flatten(cluster_9))

python_4 = GhPythonScript(Refresh=refreshall, MaterialPanel=material_17)  # -> LayerName, Roughness, Thickness, Conductivity, Density, SpecificHeat, ThermalAbsorptivity, SolarAbsorptivity, Porosity; inputs Refresh: Boolean, MaterialPanel: list; same code as python
cluster_10 = Cluster_3(solarabsorptivity=python_4.SolarAbsorptivity)
epopaquemat_4 = Honeybee_EnergyPlusOpaqueMaterial(
    name=python_4.LayerName,
    roughness=python_4.Roughness,
    thickness=python_4.Thickness,
    conductivity=python_4.Conductivity,
    density=python_4.Density,
    specificHeat=python_4.SpecificHeat,
    thermAbsp=python_4.ThermalAbsorptivity,
    solAbsp=python_4.SolarAbsorptivity,
    visAbsp=python_4.SolarAbsorptivity)  # -> EPMaterial; plug-in component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
cluster_11 = Cluster(toplayer=toplayer, layername=python_4.LayerName)  # -> surfaces_2, surfacenames_2
radopaquemat_4 = HoneybeePlus_RadianceOpaqueMaterial(name=graft(python_4.LayerName), reflect=graft(cluster_10), spec=0, rough=0)  # -> simplify(material); plug-in component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
epconstruction_4 = Honeybee_EnergyPlusConstruction(name=python_4.LayerName, layer_1=epopaquemat_4)  # -> EPConstruction; plug-in component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
cluster_12 = Cluster_2(surfaces=cluster_11.surfaces_2)
createhbsrfs_4 = Honeybee_createHBSrfs(geometry=cluster_11.surfaces_2, srfName=cluster_11.surfacenames_2, srfType="1", EPConstruction=epconstruction_4)  # -> readMe, simplify(flatten(HBSurface)); plug-in component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
hbsurface_4 = HoneybeePlus_HoneybeeSurface(geo=cluster_11.surfaces_2, names=cluster_11.surfacenames_2, type="1", rad_mat=radopaquemat_4)  # -> report, flatten(HB_srf); plug-in component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
reflectivity_4 = Data(cluster_10)
hbsrfs_energyplus_4 = Data(createhbsrfs_4.HBSurface)
hb_srfs_radiance_4 = Data(hbsurface_4.HB_srf)
boundaries_4 = Data(flatten(cluster_12))

# ----
python_5 = GhPythonScript(Refresh=refreshall, MaterialPanel=material_7)  # -> LayerName, Roughness, Thickness, Conductivity, Density, SpecificHeat, ThermalAbsorptivity, SolarAbsorptivity, Porosity; inputs Refresh: Boolean, MaterialPanel: list; same code as python
cluster_13 = Cluster(toplayer=toplayer, layername=python_5.LayerName)  # -> surfaces_2, surfacenames_2
constantschedule = Honeybee_ConstantSchedule(value=python_5.Porosity, scheduleName=python_5.LayerName)  # -> readMe, schedule, weekSched, schedIDFText; plug-in component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
radglassmaterial = Honeybee_RadianceGlassMaterial(
    materialName=python_5.LayerName,
    RTransmittance=python_5.Porosity,
    GTransmittance=python_5.Porosity,
    BTransmittance=python_5.Porosity,
    refractiveIndex=1.52)  # -> avrgTrans, RADMaterial; plug-in component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
radglassmat = HoneybeePlus_RadianceGlassMaterial(name=python_5.LayerName, t_vis=python_5.Porosity)  # -> material; plug-in component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
hb_epcontextsrf = HoneybeeEPContextSurfaces(
    shdSurfaces=flatten(cluster_13.surfaces_2),
    EPTransSchedule=constantschedule.schedule,
    RADMaterial=radglassmaterial.RADMaterial)  # -> HBContext; inputs shdSurfaces: list of Brep, justBoundingBox: Boolean
# ---------- hb_epcontextsrf: Python ----------
"""
prepare shading/context geometries

    Args:
        northVectorOrRotation: A vector that shows North or a number that shows
                               the rotation of the North from the Y axis
        bldgMasses: List of closed Breps as thermal zones.
    Returns:
        report: ...
        thermalZones: Thermal zone's geometries for visualiza
"""

ghenv.Component.Name = 'Honeybee EP context Surfaces'
ghenv.Component.NickName = 'HB_EPContextSrf'
ghenv.Component.Message = 'VER 0.0.64\nNOV_20_2018'
ghenv.Component.IconDisplayMode = ghenv.Component.IconDisplayMode.application
ghenv.Component.Category = "Honeybee"
ghenv.Component.SubCategory = "10 | Energy | Energy"
#compatibleHBVersion = VER 0.0.57\nNOV_04_2016
#compatibleLBVersion = VER 0.0.59\nFEB_01_2015
ghenv.Component.AdditionalHelpFromDocStrings = "2"

import rhinoscriptsyntax as rs
import Rhino as rc
import scriptcontext as sc
import os
import System
import Grasshopper.Kernel as gh
import uuid

tolerance = sc.doc.ModelAbsoluteTolerance
import math


def main(shdSurfaces, EPTransSchedule, meshingSettings, justBoundingBox):
    
    # import the classes
    if sc.sticky.has_key('honeybee_release'):

        try:
            if not sc.sticky['honeybee_release'].isCompatible(ghenv.Component): return -1
            if sc.sticky['honeybee_release'].isInputMissing(ghenv.Component): return -1
        except:
            warning = "You need a newer version of Honeybee to use this compoent." + \
            " Use updateHoneybee component to update userObjects.\n" + \
            "If you have already updated userObjects drag Honeybee_Honeybee component " + \
            "into canvas and try again."
            w = gh.GH_RuntimeMessageLevel.Warning
            ghenv.Component.AddRuntimeMessage(w, warning)
            return -1
        
        # don't customize this part
        hb_EPSrf = sc.sticky["honeybee_EPSurface"]
        hb_EPSHDSurface = sc.sticky["honeybee_EPShdSurface"]
        hb_RADMaterialAUX = sc.sticky["honeybee_RADMaterialAUX"]
        hb_EPObjectsAux = sc.sticky["honeybee_EPObjectsAUX"]()
        HBScheduleList = sc.sticky["honeybee_ScheduleLib"].keys()

        ########################################################################
        #----------------------------------------------------------------------#
        shdBreps = []
        # create bounding box of shading geometries
        if justBoundingBox:
            for brep in shdSurfaces:
                if brep.Faces.Count>1 or not brep.Faces[0].IsPlanar(sc.doc.ModelAbsoluteTolerance):
                    shdBreps.append(brep.GetBoundingBox(True).ToBrep())
                else:
                    shdBreps.append(brep)
        else:
            shdBreps = shdSurfaces
        
        shadingClasses = []
        shadingMeshPreview = []
        
        if meshingSettings == None:
            mp = rc.Geometry.MeshingParameters.Minimal
            mp.SimplePlanes = True
        else:
            mp = meshingSettings
        
        def getRadMaterialName(radMaterial):
            nameStr = radMaterial.split(" ")[2]
            name =  nameStr.split("\n")[0]
            return name
        
        for brepCount, brep in enumerate(shdBreps):
            if brep != None:
                isPlanar = True
                # check planarity
                for face in brep.Faces:
                    if not face.IsPlanar(tolerance):
                        isPlanar = False
                        break
                
                shadingBreps = []
                if not isPlanar:
                    meshArray = rc.Geometry.Mesh.CreateFromBrep(brep, mp)
                    for mesh in meshArray:
                        for meshFace in range(mesh.Faces.Count):
                            vertices = list(mesh.Faces.GetFaceVertices(meshFace))[1:]
                            vertices = vertices + [sc.doc.ModelAbsoluteTolerance]
                            # create the brep from mesh
                            shdBrep = rc.Geometry.Brep.CreateFromCornerPoints(*vertices)
                            shadingBreps.append(shdBrep)
                else:
                    for face in brep.Faces:
                        shadingBreps.append(face.DuplicateFace(False))
                
                for faceCount, shdBrep in enumerate(shadingBreps):
                        thisShading = hb_EPSHDSurface(shdBrep, 1000*brepCount + faceCount, 'shdSrf_' + `brepCount` + '_' + `faceCount` + "_" + str(uuid.uuid4()))
                        
                        # add transmittance schedule if any
                        if EPTransSchedule!=None:
                            schedule= EPTransSchedule.upper()
                            if schedule!=None and not schedule.lower().endswith(".csv") and schedule not in HBScheduleList:
                                msg = "Cannot find " + schedule + " in Honeybee schedule library."
                                print msg
                                ghenv.Component.AddRuntimeMessage(gh.GH_RuntimeMessageLevel.Warning, msg)
                                return -1
                            elif schedule!=None and schedule.lower().endswith(".csv"):
                                # check if csv file is existed
                                if not os.path.isfile(schedule):
                                    msg = "Cannot find the shchedule file: " + schedule
                                    print msg
                                    ghenv.Component.AddRuntimeMessage(gh.GH_RuntimeMessageLevel.Warning, msg)
                                    return -1
                            
                            thisShading.TransmittanceSCH = schedule
                        
                        # add the Rad Material if any
                        if RADMaterial!=None:
                            # if it is just the name of the material make sure it is already defined
                            if len(RADMaterial.split(" ")) == 1:
                                # if the material is not in the library add it to the library
                                if not hb_RADMaterialAUX.isMatrialExistInLibrary(RADMaterial):
                                    warningMsg = "Can't find " + RADMaterial + " in RAD Material Library.\n" + \
                                                "Add the material to the library and try again."
                                    ghenv.Component.AddRuntimeMessage(gh.GH_RuntimeMessageLevel.Warning, warningMsg)
                                    return
                                
                                try:
                                    thisShading.setRADMaterial(RADMaterial)
                                except Exception, e:
                                    print e
                                    warningMsg = "You are using an old version of Honeybee_Honeybee! Update your files and try again."
                                    print warningMsg
                                    ghenv.Component.AddRuntimeMessage(gh.GH_RuntimeMessageLevel.Warning, warningMsg)
                                    return
                                
                                addedToLib = True
                            else:
                                
                                # try to add the material to the library
                                addedToLib, thisShading.RadMaterial = hb_RADMaterialAUX.analyseRadMaterials(RADMaterial, True)
                                
                            if addedToLib==False:
                                warningMsg = "Failed to add " + RADMaterial + " to the Library."
                                ghenv.Component.AddRuntimeMessage(gh.GH_RuntimeMessageLevel.Warning, warningMsg)
                                return
                        
                        # add shading to the list
                        shadingClasses.append(thisShading)
                
        # add to the hive
        hb_hive = sc.sticky["honeybee_Hive"]()
        HBContext  = hb_hive.addToHoneybeeHive(shadingClasses, ghenv.Component)
        return HBContext
        ################################################################################################
    else:
        print "You should first let Honeybee to fly..."
        w = gh.GH_RuntimeMessageLevel.Warning
        ghenv.Component.AddRuntimeMessage(w, "You should first let Honeybee to fly...")
        return -1
        

if _shdSurfaces and _shdSurfaces[0]!=None:
    # add cleaning function
    result= main(_shdSurfaces, EPTransSchedule_, meshingSettings_, justBoundingBox_)
    
    if result != -1: HBContext = result
# ---------- end hb_epcontextsrf ----------
hbsurface_5 = HoneybeePlus_HoneybeeSurface(geo=cluster_13.surfaces_2, type="6", rad_mat=radglassmat)  # -> report, flatten(HB_srf); plug-in component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
hbcontextsrfs_energyplus = Data(hb_epcontextsrf)
hb_srfs_radiance_5 = Data(hbsurface_5.HB_srf)

python_6 = GhPythonScript(Refresh=refreshall, MaterialPanel=material_8)  # -> LayerName, Roughness, Thickness, Conductivity, Density, SpecificHeat, ThermalAbsorptivity, SolarAbsorptivity, Porosity; inputs Refresh: Boolean, MaterialPanel: list; same code as python
cluster_14 = Cluster(toplayer=toplayer, layername=python_6.LayerName)  # -> surfaces_2, surfacenames_2
constantschedule_2 = Honeybee_ConstantSchedule(value=python_6.Porosity, scheduleName=python_6.LayerName)  # -> readMe, schedule, weekSched, schedIDFText; plug-in component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
radglassmaterial_2 = Honeybee_RadianceGlassMaterial(
    materialName=python_6.LayerName,
    RTransmittance=python_6.Porosity,
    GTransmittance=python_6.Porosity,
    BTransmittance=python_6.Porosity,
    refractiveIndex=1.52)  # -> avrgTrans, RADMaterial; plug-in component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
radglassmat_2 = HoneybeePlus_RadianceGlassMaterial(name=python_6.LayerName, t_vis=python_6.Porosity)  # -> material; plug-in component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
hb_epcontextsrf_2 = HoneybeeEPContextSurfaces(
    shdSurfaces=flatten(cluster_14.surfaces_2),
    EPTransSchedule=constantschedule_2.schedule,
    RADMaterial=radglassmaterial_2.RADMaterial)  # -> HBContext; inputs shdSurfaces: list of Brep, justBoundingBox: Boolean; same code as hb_epcontextsrf
hbsurface_6 = HoneybeePlus_HoneybeeSurface(geo=cluster_14.surfaces_2, type="6", rad_mat=radglassmat_2)  # -> report, flatten(HB_srf); plug-in component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
hbcontextsrfs_energyplus_2 = Data(hb_epcontextsrf_2)
hb_srfs_radiance_6 = Data(hbsurface_6.HB_srf)

# ---- group: GROUND SURFACES
python_7 = GhPythonScript(Refresh=refreshall, MaterialPanel=material_3)  # -> LayerName, Roughness, Thickness, Conductivity, Density, SpecificHeat, ThermalAbsorptivity, SolarAbsorptivity, Porosity; inputs Refresh: Boolean, MaterialPanel: list; same code as python
cluster_15 = Cluster_3(solarabsorptivity=python_7.SolarAbsorptivity)
epopaquemat_5 = Honeybee_EnergyPlusOpaqueMaterial(
    name=python_7.LayerName,
    roughness=python_7.Roughness,
    thickness=python_7.Thickness,
    conductivity=python_7.Conductivity,
    density=python_7.Density,
    specificHeat=python_7.SpecificHeat,
    thermAbsp=python_7.ThermalAbsorptivity,
    solAbsp=python_7.SolarAbsorptivity,
    visAbsp=python_7.SolarAbsorptivity)  # -> EPMaterial; plug-in component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
cluster_16 = Cluster(toplayer=toplayer, layername=python_7.LayerName)  # -> surfaces_2, surfacenames_2
radopaquemat_5 = HoneybeePlus_RadianceOpaqueMaterial(name=graft(python_7.LayerName), reflect=graft(cluster_15), spec=0, rough=0)  # -> simplify(material); plug-in component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
epconstruction_5 = Honeybee_EnergyPlusConstruction(name=python_7.LayerName, layer_1=epopaquemat_5)  # -> EPConstruction; plug-in component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
cluster_17 = Cluster_2(surfaces=cluster_16.surfaces_2)
createhbsrfs_5 = Honeybee_createHBSrfs(geometry=cluster_16.surfaces_2, srfName=cluster_16.surfacenames_2, srfType="1", EPConstruction=epconstruction_5)  # -> readMe, simplify(flatten(HBSurface)); plug-in component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
hbsurface_7 = HoneybeePlus_HoneybeeSurface(geo=cluster_16.surfaces_2, names=cluster_16.surfacenames_2, type="1", rad_mat=radopaquemat_5)  # -> report, flatten(HB_srf); plug-in component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
hbsrfs_energyplus_5 = Data(createhbsrfs_5.HBSurface)
hb_srfs_radiance_7 = Data(hbsurface_7.HB_srf)
reflectivity_5 = Data(cluster_15)
boundaries_5 = Data(flatten(cluster_17))

python_8 = GhPythonScript(Refresh=refreshall, MaterialPanel=material_5)  # -> LayerName, Roughness, Thickness, Conductivity, Density, SpecificHeat, ThermalAbsorptivity, SolarAbsorptivity, Porosity; inputs Refresh: Boolean, MaterialPanel: list; same code as python
cluster_18 = Cluster_3(solarabsorptivity=python_8.SolarAbsorptivity)
epopaquemat_6 = Honeybee_EnergyPlusOpaqueMaterial(
    name=python_8.LayerName,
    roughness=python_8.Roughness,
    thickness=python_8.Thickness,
    conductivity=python_8.Conductivity,
    density=python_8.Density,
    specificHeat=python_8.SpecificHeat,
    thermAbsp=python_8.ThermalAbsorptivity,
    solAbsp=python_8.SolarAbsorptivity,
    visAbsp=python_8.SolarAbsorptivity)  # -> EPMaterial; plug-in component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
cluster_19 = Cluster(toplayer=toplayer, layername=python_8.LayerName)  # -> surfaces_2, surfacenames_2
radopaquemat_6 = HoneybeePlus_RadianceOpaqueMaterial(name=graft(python_8.LayerName), reflect=graft(cluster_18), spec=0, rough=0)  # -> simplify(material); plug-in component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
epconstruction_6 = Honeybee_EnergyPlusConstruction(name=python_8.LayerName, layer_1=epopaquemat_6)  # -> EPConstruction; plug-in component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
cluster_20 = Cluster_2(surfaces=cluster_19.surfaces_2)
createhbsrfs_6 = Honeybee_createHBSrfs(geometry=cluster_19.surfaces_2, srfName=cluster_19.surfacenames_2, srfType="1", EPConstruction=epconstruction_6)  # -> readMe, simplify(flatten(HBSurface)); plug-in component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
hbsurface_8 = HoneybeePlus_HoneybeeSurface(geo=cluster_19.surfaces_2, names=cluster_19.surfacenames_2, type="1", rad_mat=radopaquemat_6)  # -> report, flatten(HB_srf); plug-in component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
hbsrfs_energyplus_6 = Data(createhbsrfs_6.HBSurface)
hb_srfs_radiance_8 = Data(hbsurface_8.HB_srf)
boundaries_6 = Data(flatten(cluster_20))
reflectivity_6 = Data(cluster_18)

# ----
python_9 = GhPythonScript(Refresh=refreshall, MaterialPanel=material_2)  # -> LayerName, Roughness, Thickness, Conductivity, Density, SpecificHeat, ThermalAbsorptivity, SolarAbsorptivity, Porosity; inputs Refresh: Boolean, MaterialPanel: list; same code as python
cluster_21 = Cluster(toplayer=toplayer, layername=python_9.LayerName)  # -> surfaces_2, surfacenames_2
constantschedule_3 = Honeybee_ConstantSchedule(value=python_9.Porosity, scheduleName=python_9.LayerName)  # -> readMe, schedule, weekSched, schedIDFText; plug-in component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
radglassmaterial_3 = Honeybee_RadianceGlassMaterial(
    materialName=python_9.LayerName,
    RTransmittance=python_9.Porosity,
    GTransmittance=python_9.Porosity,
    BTransmittance=python_9.Porosity,
    refractiveIndex=1.52)  # -> avrgTrans, RADMaterial; plug-in component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
radglassmat_3 = HoneybeePlus_RadianceGlassMaterial(name=python_9.LayerName, t_vis=python_9.Porosity)  # -> material; plug-in component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
hb_epcontextsrf_3 = HoneybeeEPContextSurfaces(
    shdSurfaces=flatten(cluster_21.surfaces_2),
    EPTransSchedule=constantschedule_3.schedule,
    RADMaterial=radglassmaterial_3.RADMaterial)  # -> HBContext; inputs shdSurfaces: list of Brep, justBoundingBox: Boolean; same code as hb_epcontextsrf
hbsurface_9 = HoneybeePlus_HoneybeeSurface(geo=cluster_21.surfaces_2, type="6", rad_mat=radglassmat_3)  # -> report, flatten(HB_srf); plug-in component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
hbcontextsrfs_energyplus_3 = Data(hb_epcontextsrf_3)
hb_srfs_radiance_9 = Data(hbsurface_9.HB_srf)

# ---- group: GROUND SURFACES
python_10 = GhPythonScript(Refresh=refreshall, MaterialPanel=material_19)  # -> LayerName, Roughness, Thickness, Conductivity, Density, SpecificHeat, ThermalAbsorptivity, SolarAbsorptivity, Porosity; inputs Refresh: Boolean, MaterialPanel: list; same code as python
cluster_22 = Cluster_3(solarabsorptivity=python_10.SolarAbsorptivity)
epopaquemat_7 = Honeybee_EnergyPlusOpaqueMaterial(
    name=python_10.LayerName,
    roughness=python_10.Roughness,
    thickness=python_10.Thickness,
    conductivity=python_10.Conductivity,
    density=python_10.Density,
    specificHeat=python_10.SpecificHeat,
    thermAbsp=python_10.ThermalAbsorptivity,
    solAbsp=python_10.SolarAbsorptivity,
    visAbsp=python_10.SolarAbsorptivity)  # -> EPMaterial; plug-in component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
cluster_23 = Cluster(toplayer=toplayer, layername=python_10.LayerName)  # -> surfaces_2, surfacenames_2
radopaquemat_7 = HoneybeePlus_RadianceOpaqueMaterial(name=graft(python_10.LayerName), reflect=graft(cluster_22), spec=0, rough=0)  # -> simplify(material); plug-in component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
epconstruction_7 = Honeybee_EnergyPlusConstruction(name=python_10.LayerName, layer_1=epopaquemat_7)  # -> EPConstruction; plug-in component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
cluster_24 = Cluster_2(surfaces=cluster_23.surfaces_2)
createhbsrfs_7 = Honeybee_createHBSrfs(geometry=cluster_23.surfaces_2, srfName=cluster_23.surfacenames_2, srfType="1", EPConstruction=epconstruction_7)  # -> readMe, simplify(flatten(HBSurface)); plug-in component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
hbsurface_10 = HoneybeePlus_HoneybeeSurface(geo=cluster_23.surfaces_2, names=cluster_23.surfacenames_2, type="1", rad_mat=radopaquemat_7)  # -> report, flatten(HB_srf); plug-in component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
hbsrfs_energyplus_7 = Data(createhbsrfs_7.HBSurface)
hb_srfs_radiance_10 = Data(hbsurface_10.HB_srf)
boundaries_7 = Data(flatten(cluster_24))
reflectivity_7 = Data(cluster_22)

# ----
python_11 = GhPythonScript(Refresh=refreshall, MaterialPanel=material_4)  # -> LayerName, Roughness, Thickness, Conductivity, Density, SpecificHeat, ThermalAbsorptivity, SolarAbsorptivity, Porosity; inputs Refresh: Boolean, MaterialPanel: list; same code as python
cluster_25 = Cluster(toplayer=toplayer, layername=python_11.LayerName)  # -> surfaces_2, surfacenames_2
constantschedule_4 = Honeybee_ConstantSchedule(value=python_11.Porosity, scheduleName=python_11.LayerName)  # -> readMe, schedule, weekSched, schedIDFText; plug-in component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
radglassmaterial_4 = Honeybee_RadianceGlassMaterial(
    materialName=python_11.LayerName,
    RTransmittance=python_11.Porosity,
    GTransmittance=python_11.Porosity,
    BTransmittance=python_11.Porosity,
    refractiveIndex=1.52)  # -> avrgTrans, RADMaterial; plug-in component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
radglassmat_4 = HoneybeePlus_RadianceGlassMaterial(name=python_11.LayerName, t_vis=python_11.Porosity)  # -> material; plug-in component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
hb_epcontextsrf_4 = HoneybeeEPContextSurfaces(
    shdSurfaces=flatten(cluster_25.surfaces_2),
    EPTransSchedule=constantschedule_4.schedule,
    RADMaterial=radglassmaterial_4.RADMaterial)  # -> HBContext; inputs shdSurfaces: list of Brep, justBoundingBox: Boolean; same code as hb_epcontextsrf
hbsurface_11 = HoneybeePlus_HoneybeeSurface(geo=cluster_25.surfaces_2, type="6", rad_mat=radglassmat_4)  # -> report, flatten(HB_srf); plug-in component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
hbcontextsrfs_energyplus_4 = Data(hb_epcontextsrf_4)
hb_srfs_radiance_11 = Data(hbsurface_11.HB_srf)

python_12 = GhPythonScript(Refresh=refreshall, MaterialPanel=material)  # -> LayerName, Roughness, Thickness, Conductivity, Density, SpecificHeat, ThermalAbsorptivity, SolarAbsorptivity, Porosity; inputs Refresh: Boolean, MaterialPanel: list; same code as python
cluster_26 = Cluster(toplayer=toplayer, layername=python_12.LayerName)  # -> surfaces_2, surfacenames_2
constantschedule_5 = Honeybee_ConstantSchedule(value=python_12.Porosity, scheduleName=python_12.LayerName)  # -> readMe, schedule, weekSched, schedIDFText; plug-in component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
radglassmaterial_5 = Honeybee_RadianceGlassMaterial(
    materialName=python_12.LayerName,
    RTransmittance=python_12.Porosity,
    GTransmittance=python_12.Porosity,
    BTransmittance=python_12.Porosity,
    refractiveIndex=1.52)  # -> avrgTrans, RADMaterial; plug-in component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
radglassmat_5 = HoneybeePlus_RadianceGlassMaterial(name=python_12.LayerName, t_vis=python_12.Porosity)  # -> material; plug-in component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
hb_epcontextsrf_5 = HoneybeeEPContextSurfaces(
    shdSurfaces=flatten(cluster_26.surfaces_2),
    EPTransSchedule=constantschedule_5.schedule,
    RADMaterial=radglassmaterial_5.RADMaterial)  # -> HBContext; inputs shdSurfaces: list of Brep, justBoundingBox: Boolean; same code as hb_epcontextsrf
hbsurface_12 = HoneybeePlus_HoneybeeSurface(geo=cluster_26.surfaces_2, type="6", rad_mat=radglassmat_5)  # -> report, flatten(HB_srf); plug-in component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
hbcontextsrfs_energyplus_5 = Data(hb_epcontextsrf_5)
hb_srfs_radiance_12 = Data(hbsurface_12.HB_srf)

# ---- group: GROUND SURFACES
python_13 = GhPythonScript(Refresh=refreshall, MaterialPanel=material_15)  # -> LayerName, Roughness, Thickness, Conductivity, Density, SpecificHeat, ThermalAbsorptivity, SolarAbsorptivity, Porosity; inputs Refresh: Boolean, MaterialPanel: list; same code as python
cluster_27 = Cluster_3(solarabsorptivity=python_13.SolarAbsorptivity)
epopaquemat_8 = Honeybee_EnergyPlusOpaqueMaterial(
    name=python_13.LayerName,
    roughness=python_13.Roughness,
    thickness=python_13.Thickness,
    conductivity=python_13.Conductivity,
    density=python_13.Density,
    specificHeat=python_13.SpecificHeat,
    thermAbsp=python_13.ThermalAbsorptivity,
    solAbsp=python_13.SolarAbsorptivity,
    visAbsp=python_13.SolarAbsorptivity)  # -> EPMaterial; plug-in component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
cluster_28 = Cluster(toplayer=toplayer, layername=python_13.LayerName)  # -> surfaces_2, surfacenames_2
radopaquemat_8 = HoneybeePlus_RadianceOpaqueMaterial(name=graft(python_13.LayerName), reflect=graft(cluster_27), spec=0, rough=0)  # -> simplify(material); plug-in component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
epconstruction_8 = Honeybee_EnergyPlusConstruction(name=python_13.LayerName, layer_1=epopaquemat_8)  # -> EPConstruction; plug-in component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
cluster_29 = Cluster_2(surfaces=cluster_28.surfaces_2)
createhbsrfs_8 = Honeybee_createHBSrfs(geometry=cluster_28.surfaces_2, srfName=cluster_28.surfacenames_2, srfType="1", EPConstruction=epconstruction_8)  # -> readMe, simplify(flatten(HBSurface)); plug-in component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
hbsurface_13 = HoneybeePlus_HoneybeeSurface(geo=cluster_28.surfaces_2, names=cluster_28.surfacenames_2, type="1", rad_mat=radopaquemat_8)  # -> report, flatten(HB_srf); plug-in component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
hbsrfs_energyplus_8 = Data(createhbsrfs_8.HBSurface)
hb_srfs_radiance_13 = Data(hbsurface_13.HB_srf)
boundaries_8 = Data(flatten(cluster_29))
reflectivity_8 = Data(cluster_27)

python_14 = GhPythonScript(Refresh=refreshall, MaterialPanel=material_10)  # -> LayerName, Roughness, Thickness, Conductivity, Density, SpecificHeat, ThermalAbsorptivity, SolarAbsorptivity, Porosity; inputs Refresh: Boolean, MaterialPanel: list; same code as python
cluster_30 = Cluster_3(solarabsorptivity=python_14.SolarAbsorptivity)
epopaquemat_9 = Honeybee_EnergyPlusOpaqueMaterial(
    name=python_14.LayerName,
    roughness=python_14.Roughness,
    thickness=python_14.Thickness,
    conductivity=python_14.Conductivity,
    density=python_14.Density,
    specificHeat=python_14.SpecificHeat,
    thermAbsp=python_14.ThermalAbsorptivity,
    solAbsp=python_14.SolarAbsorptivity,
    visAbsp=python_14.SolarAbsorptivity)  # -> EPMaterial; plug-in component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
cluster_31 = Cluster(toplayer=toplayer, layername=python_14.LayerName)  # -> surfaces_2, surfacenames_2
radopaquemat_9 = HoneybeePlus_RadianceOpaqueMaterial(name=graft(python_14.LayerName), reflect=graft(cluster_30), spec=0, rough=0)  # -> simplify(material); plug-in component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
epconstruction_9 = Honeybee_EnergyPlusConstruction(name=python_14.LayerName, layer_1=epopaquemat_9)  # -> EPConstruction; plug-in component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
cluster_32 = Cluster_2(surfaces=cluster_31.surfaces_2)
createhbsrfs_9 = Honeybee_createHBSrfs(geometry=cluster_31.surfaces_2, srfName=cluster_31.surfacenames_2, srfType="1", EPConstruction=epconstruction_9)  # -> readMe, simplify(flatten(HBSurface)); plug-in component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
hbsurface_14 = HoneybeePlus_HoneybeeSurface(geo=cluster_31.surfaces_2, names=cluster_31.surfacenames_2, type="1", rad_mat=radopaquemat_9)  # -> report, flatten(HB_srf); plug-in component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
hbsrfs_energyplus_9 = Data(createhbsrfs_9.HBSurface)
hb_srfs_radiance_14 = Data(hbsurface_14.HB_srf)
boundaries_9 = Data(flatten(cluster_32))
reflectivity_9 = Data(cluster_30)

python_15 = GhPythonScript(Refresh=refreshall, MaterialPanel=material_11)  # -> LayerName, Roughness, Thickness, Conductivity, Density, SpecificHeat, ThermalAbsorptivity, SolarAbsorptivity, Porosity; inputs Refresh: Boolean, MaterialPanel: list; same code as python
cluster_33 = Cluster_3(solarabsorptivity=python_15.SolarAbsorptivity)
epopaquemat_10 = Honeybee_EnergyPlusOpaqueMaterial(
    name=python_15.LayerName,
    roughness=python_15.Roughness,
    thickness=python_15.Thickness,
    conductivity=python_15.Conductivity,
    density=python_15.Density,
    specificHeat=python_15.SpecificHeat,
    thermAbsp=python_15.ThermalAbsorptivity,
    solAbsp=python_15.SolarAbsorptivity,
    visAbsp=python_15.SolarAbsorptivity)  # -> EPMaterial; plug-in component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
cluster_34 = Cluster(toplayer=toplayer, layername=python_15.LayerName)  # -> surfaces_2, surfacenames_2
radopaquemat_10 = HoneybeePlus_RadianceOpaqueMaterial(name=graft(python_15.LayerName), reflect=graft(cluster_33), spec=0, rough=0)  # -> simplify(material); plug-in component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
epconstruction_10 = Honeybee_EnergyPlusConstruction(name=python_15.LayerName, layer_1=epopaquemat_10)  # -> EPConstruction; plug-in component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
cluster_35 = Cluster_2(surfaces=cluster_34.surfaces_2)
createhbsrfs_10 = Honeybee_createHBSrfs(geometry=cluster_34.surfaces_2, srfName=cluster_34.surfacenames_2, srfType="1", EPConstruction=epconstruction_10)  # -> readMe, simplify(flatten(HBSurface)); plug-in component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
hbsurface_15 = HoneybeePlus_HoneybeeSurface(geo=cluster_34.surfaces_2, names=cluster_34.surfacenames_2, type="1", rad_mat=radopaquemat_10)  # -> report, flatten(HB_srf); plug-in component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
hbsrfs_energyplus_10 = Data(createhbsrfs_10.HBSurface)
hb_srfs_radiance_15 = Data(hbsurface_15.HB_srf)
boundaries_10 = Data(flatten(cluster_35))
reflectivity_10 = Data(cluster_33)

# ----
python_16 = GhPythonScript(Refresh=refreshall, MaterialPanel=material_14)  # -> LayerName, Roughness, Thickness, Conductivity, Density, SpecificHeat, ThermalAbsorptivity, SolarAbsorptivity, Porosity; inputs Refresh: Boolean, MaterialPanel: list; same code as python
cluster_36 = Cluster(toplayer=toplayer, layername=python_16.LayerName)  # -> surfaces_2, surfacenames_2
constantschedule_6 = Honeybee_ConstantSchedule(value=python_16.Porosity, scheduleName=python_16.LayerName)  # -> readMe, schedule, weekSched, schedIDFText; plug-in component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
radglassmaterial_6 = Honeybee_RadianceGlassMaterial(
    materialName=python_16.LayerName,
    RTransmittance=python_16.Porosity,
    GTransmittance=python_16.Porosity,
    BTransmittance=python_16.Porosity,
    refractiveIndex=1.52)  # -> avrgTrans, RADMaterial; plug-in component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
radglassmat_6 = HoneybeePlus_RadianceGlassMaterial(name=python_16.LayerName, t_vis=python_16.Porosity)  # -> material; plug-in component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
hb_epcontextsrf_6 = HoneybeeEPContextSurfaces(
    shdSurfaces=flatten(cluster_36.surfaces_2),
    EPTransSchedule=constantschedule_6.schedule,
    RADMaterial=radglassmaterial_6.RADMaterial)  # -> HBContext; inputs shdSurfaces: list of Brep, justBoundingBox: Boolean; same code as hb_epcontextsrf
hbsurface_16 = HoneybeePlus_HoneybeeSurface(geo=cluster_36.surfaces_2, type="6", rad_mat=radglassmat_6)  # -> report, flatten(HB_srf); plug-in component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
hbcontextsrfs_energyplus_6 = Data(hb_epcontextsrf_6)
hb_srfs_radiance_16 = Data(hbsurface_16.HB_srf)

# ---- group: CONTEXT BUILDING MASSES
python_17 = GhPythonScript(Refresh=refreshall, MaterialPanel=material_18)  # -> LayerName, Roughness, Thickness, Conductivity, Density, SpecificHeat, ThermalAbsorptivity, SolarAbsorptivity, Porosity; inputs Refresh: Boolean, MaterialPanel: list; same code as python
cluster_37 = Cluster_4(toplayer=toplayer, layername=python_17.LayerName)  # -> brep_2, brepnames_2
cluster_38 = Cluster_3(solarabsorptivity=python_17.SolarAbsorptivity)
epopaquemat_11 = Honeybee_EnergyPlusOpaqueMaterial(
    name=python_17.LayerName,
    roughness=python_17.Roughness,
    thickness=python_17.Thickness,
    conductivity=python_17.Conductivity,
    density=python_17.Density,
    specificHeat=python_17.SpecificHeat,
    thermAbsp=python_17.ThermalAbsorptivity,
    solAbsp=python_17.SolarAbsorptivity,
    visAbsp=python_17.SolarAbsorptivity)  # -> EPMaterial; plug-in component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
debrep = DeconstructBrep(Brep=cluster_37.brep_2)  # -> flatten(Faces), Edges, Vertices
lng = ListLength(List=debrep.Faces)
mass2zone = Honeybee_Masses2Zones(zoneMasses=flatten(cluster_37.brep_2), zoneNames=cluster_37.brepnames_2, maxRoofAngle=30, createHBZones=Toggle(True))  # -> readMe, HBZones; plug-in component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
radopaquemat_11 = HoneybeePlus_RadianceOpaqueMaterial(reflect=graft(cluster_38), spec=0, rough=0)  # -> simplify(material); plug-in component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
epconstruction_11 = Honeybee_EnergyPlusConstruction(name=python_17.LayerName, layer_1=epopaquemat_11)  # -> EPConstruction; plug-in component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
series = Series(Start=0, Step=1, Count=lng)
concat = Concatenate(FragmentB=series)
setepzonecnstr = Honeybee_SetEPZoneConstruction(
    HBZones=flatten(mass2zone.HBZones),
    wallEPConstruction=epconstruction_11,
    roofEPConstruction=epconstruction_11,
    floorEPConstruction=epconstruction_11,
    expFloorEPConstruction=epconstruction_11)  # -> simplify(modifiedHBZones); plug-in component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
hbsurface_17 = HoneybeePlus_HoneybeeSurface(geo=debrep.Faces, names=concat, type="0", rad_mat=radopaquemat_11)  # -> report, flatten(HB_srf); plug-in component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
hbzones_energyplus = Data(setepzonecnstr)
hb_srfs_radiance_17 = Data(hbsurface_17.HB_srf)

# ---- group: GROUND SURFACES
python_18 = GhPythonScript(Refresh=refreshall, MaterialPanel=material_12)  # -> LayerName, Roughness, Thickness, Conductivity, Density, SpecificHeat, ThermalAbsorptivity, SolarAbsorptivity, Porosity; inputs Refresh: Boolean, MaterialPanel: list; same code as python
cluster_39 = Cluster_3(solarabsorptivity=python_18.SolarAbsorptivity)
epopaquemat_12 = Honeybee_EnergyPlusOpaqueMaterial(
    name=python_18.LayerName,
    roughness=python_18.Roughness,
    thickness=python_18.Thickness,
    conductivity=python_18.Conductivity,
    density=python_18.Density,
    specificHeat=python_18.SpecificHeat,
    thermAbsp=python_18.ThermalAbsorptivity,
    solAbsp=python_18.SolarAbsorptivity,
    visAbsp=python_18.SolarAbsorptivity)  # -> EPMaterial; plug-in component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
cluster_40 = Cluster(toplayer=toplayer, layername=python_18.LayerName)  # -> surfaces_2, surfacenames_2
radopaquemat_12 = HoneybeePlus_RadianceOpaqueMaterial(name=graft(python_18.LayerName), reflect=graft(cluster_39), spec=0, rough=0)  # -> simplify(material); plug-in component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
epconstruction_12 = Honeybee_EnergyPlusConstruction(name=python_18.LayerName, layer_1=epopaquemat_12)  # -> EPConstruction; plug-in component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
cluster_41 = Cluster_2(surfaces=cluster_40.surfaces_2)
createhbsrfs_11 = Honeybee_createHBSrfs(geometry=cluster_40.surfaces_2, srfName=cluster_40.surfacenames_2, srfType="1", EPConstruction=epconstruction_12)  # -> readMe, simplify(flatten(HBSurface)); plug-in component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
hbsurface_18 = HoneybeePlus_HoneybeeSurface(geo=cluster_40.surfaces_2, names=cluster_40.surfacenames_2, type="1", rad_mat=radopaquemat_12)  # -> report, flatten(HB_srf); plug-in component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
hbsrfs_energyplus_11 = Data(createhbsrfs_11.HBSurface)
hb_srfs_radiance_18 = Data(hbsurface_18.HB_srf)
boundaries_11 = Data(flatten(cluster_41))
reflectivity_11 = Data(cluster_39)

# ---- group: ANALYSIS POINTS
concat_2 = Concatenate(FragmentA=toplayer, FragmentC="::", FragmentB="ANALYSIS_REGION")
concat_3 = Concatenate(FragmentA=toplayer, FragmentC="::", FragmentB="ANALYSIS_PLANE")
dpipeline = DynamicGeometryPipeline(
    LayerFilter=concat_2,
    TypeFilter="Brep",
    NameFilter="*",
    GroupByLayer=False,
    GroupByType=False,
    IncludeHidden=True,
    IncludeLocked=True,
    enableFullPath=True,
    listenToAttributes=True)  # -> simplify(GeometryOut)
dpipeline_2 = DynamicGeometryPipeline(
    LayerFilter=concat_3,
    TypeFilter="Brep",
    NameFilter="*",
    GroupByLayer=False,
    GroupByType=False,
    IncludeHidden=True,
    IncludeLocked=True,
    enableFullPath=True,
    listenToAttributes=True)  # -> simplify(GeometryOut)
edges = BrepEdges(Brep=dpipeline)  # -> Naked, Interior, NonManifold
Z = UnitZ(Factor="100")
move = Move(Geometry=dpipeline, Motion=Z)  # -> Geometry, Transform
join = JoinCurves(Curves=edges.Naked, Preserve=False)
cp = ControlPoints(Curve=join)  # -> flatten(Points), Weights, Knots
genpts = Ladybug_GeneratePointGrid(geometry=move.Geometry, grid_size="1.25", dist_surface="0")  # -> flatten(points), flatten(vectors), flatten(face_areas), mesh; plug-in component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
lng_2 = ListLength(List=cp.Points)
subtraction = Subtraction(A=lng_2, B="1")
project = ProjectPoint(Point=genpts.points, Direction=Vector(0, 0, -1), Geometry=dpipeline_2)  # -> Point, Index
split = SplitList(List=cp.Points, Index=subtraction)  # -> ListA, ListB

# ----
panel = Panel("""FAMILYPARK2 = 1.25
FAMILYPARK1 = 1.2
AirportRd_P1 = 1.6
AirportRd_P2 = 0.675
AirportRd_P3 = 1""")

# ---- group: ANALYSIS POINT GROUND REFLECTIVITIES
entwine = Entwine(
    Branch00=reflectivity_9,
    Branch01=reflectivity_10,
    Branch02=reflectivity_8,
    Branch03=reflectivity_11,
    Branch04=reflectivity_7,
    Branch05=reflectivity_2,
    Branch06=reflectivity_6,
    Branch07=reflectivity_4,
    Branch08=reflectivity_5,
    Branch09=reflectivity_3,
    Branch010=reflectivity,
    FlattenInputs=True)  # -> simplify(flatten(Result))
entwine_2 = Entwine(
    Branch00=boundaries_9,
    Branch01=boundaries_10,
    Branch02=boundaries_8,
    Branch03=boundaries_11,
    Branch04=boundaries_7,
    Branch05=boundaries_2,
    Branch06=boundaries_6,
    Branch07=boundaries_4,
    Branch08=boundaries_5,
    Branch09=boundaries_3,
    Branch010=boundaries,
    FlattenInputs=True)  # -> simplify(Result)
null = NullItem(Item=entwine_2)  # -> NullFlags, InvalidFlags, Description
toggle = BooleanToggle(True)
cull = CullPattern(List=entwine_2, CullPattern=invert(null.InvalidFlags))
ma = MassAddition(Input=null.InvalidFlags)  # -> flatten(Result), PartialResults
equals = Equality(FirstNumber="0", SecondNumber=ma.Result)  # -> Equality, Inequality
clean = CleanTree(RemoveNulls=toggle, RemoveInvalid=toggle, RemoveEmpty=toggle, Tree=cull)
dispatch = Dispatch(List=entwine, DispatchPattern=flatten(equals.Equality))  # -> ListA, ListB
project_2 = Project(Geometry=clean, Plane=PlaneXY(0, 0, 0))  # -> Geometry, Transform
incurve = PointInCurve(Point=project.Point, Curve=graft(project_2.Geometry))  # -> simplify(Relationship), Point
lng_3 = ListLength(List=project_2.Geometry)  # -> flatten(Length)
dup = DuplicateData(Data=graft(dispatch.ListA), Number=graft(lng_3), Order=True)  # -> flatten(Data)
larger = LargerThan(FirstNumber=incurve.Relationship, SecondNumber="1")  # -> LargerThan, OrEqualTo
dispatch_2 = Dispatch(List=project.Point, DispatchPattern=larger.OrEqualTo)  # -> simplify(ListA), ListB
lng_4 = ListLength(List=simplify(dispatch_2.ListA))
dup_2 = DuplicateData(Data=simplify(graft(dup)), Number=simplify(graft(lng_4)), Order=True)

# ----
toggle_2 = BooleanToggle(True)  # disabled
list = ValueList({"Per tree": 1, "Per branch": 2}, selected="Per tree")  # disabled
list_2 = ValueList({"Demo": 1, "User tree": 2}, selected="User tree")  # disabled
c_script = CSharpScript(enable=toggle_2, mode=list_2, userTree=dispatch_2.ListA, uniqueMode=list)  # -> out, Elapsed, uniquePtsTree, duplicatePtsTree, duplicatePtsRemovedTree; inputs enable: Boolean, mode: Int32, userTree: tree of Point3d, count: Int32, branchItems: Int32, decimals: Int32, scale: Double, dupliMin: Int32, dupliMax: Int32, uniqueMode: Int32; disabled
# ---------- c_script: C# ----------
    // by The Lord of Darkness due to critical Tequila starvation issues (Vodka is the solution).

    System.Diagnostics.Stopwatch sw = new System.Diagnostics.Stopwatch();
    sw.Start();

    //-------------------------------------------------------------- better safe than sorry
    if(!enable)return;
    List<Point3d> userPts = userTree.AllData().ToList();
    userPts = userPts.Where(x => x != Point3d.Unset).ToList();

    //-------------------------------------------------------------- better safe than sorry
    if(mode == 2 && !userPts.Any()){Print(" "); Print("No user data: Demo ON"); mode = 1;}
    DataTree<Point3d> dupesRemovedTree = new DataTree<Point3d>();
    UM = uniqueMode;

    if(mode == 1){
      DataTree<Point3d> dupesTree = new DataTree<Point3d>();
      DataTree<Point3d> uniTree = new DataTree<Point3d>();
      Random rnd = new Random();
      int D = decimals;
      MakeDemoTrees(ref dupesTree, ref uniTree, rnd, D, count, branchItems, scale, dupliMin, dupliMax);

      uniquePtsTree = uniTree;      //>>out
      duplicatePtsTree = dupesTree; //>>out

      RemoveDupes(dupesTree, ref dupesRemovedTree);
      duplicatePtsRemovedTree = dupesRemovedTree; //>>out

      Print(" ");
      Print("Made: {0} unique pts in {1} branches", uniTree.DataCount, uniTree.BranchCount);
      Print(" ");
      Print("Made: {0} dupe/unique pts in {1} branches", dupesTree.DataCount, dupesTree.BranchCount);
      Print("Dupes removal: {0} unique pts in {1} branches", dupesRemovedTree.DataCount, dupesRemovedTree.BranchCount);
    }
    else{
      Print(" ");
      Print("UserTree WARNING No unique pts check");

      uniquePtsTree = userTree;      //>>out
      RemoveDupes(userTree, ref dupesRemovedTree);
      duplicatePtsRemovedTree = dupesRemovedTree; //>>out

      Print(" ");
      Print("UserTree: {0} pts in {1} branches", userTree.DataCount, userTree.BranchCount);
      Print("Dupes removal: {0} unique pts in {1} branches", dupesRemovedTree.DataCount, dupesRemovedTree.BranchCount);
    }

    sw.Stop();
    Elapsed = (string.Format("Elapsed: {0}ms", sw.Elapsed.TotalMilliseconds));
# ---------- c_script: C# additional code ----------
  private void MakeDemoTrees(ref DataTree<Point3d> dupesTree, ref DataTree<Point3d> uniTree,
  Random rnd, int D, int count, int branchItems, double scale, int dupliMin, int dupliMax){

    int items = 0;
    int branch = 0;
    HashSet<Point3d> unique = new HashSet<Point3d>();

    for(int i = 0; i < count; i++){
      int hashCount = unique.Count;
      Point3d p = new Point3d(Math.Round((rnd.NextDouble() * scale), D), Math.Round((rnd.NextDouble() * scale), D), Math.Round((rnd.NextDouble() * scale), D));
      unique.Add(p);
      if(hashCount < unique.Count){
        uniTree.Add(p, new GH_Path(branch));
        for(int j = 0; j < rnd.Next(dupliMin, dupliMax);j++){
          dupesTree.Add(p, new GH_Path(branch));
        }
        items++;
        if(items >= branchItems){ branch++; items = 0;}
      }
    }
  }

  public int UM; // unique mode, that is (per tree [1] or per branch [2])

  private void RemoveDupes(DataTree<Point3d> inputTree, ref DataTree<Point3d> outputTree){
    HashSet<Point3d> unique = new HashSet<Point3d>();
    foreach(GH_Path path in inputTree.Paths){
      List<Point3d> pts = inputTree.Branch(path).ToList();
      foreach(Point3d p in pts){
        int hashCount = unique.Count;
        unique.Add(p);
        if(hashCount < unique.Count){
          outputTree.Add(p, new GH_Path(path));
        }
      }
      if(UM == 2) unique.Clear();
    }
  }
# ---------- end c_script ----------
merge = Merge(
    Data1=hbcontextsrfs_energyplus_6,
    Data2=hbcontextsrfs_energyplus_4,
    Data3=hbcontextsrfs_energyplus,
    Data4=hbcontextsrfs_energyplus_2,
    Data5=hbcontextsrfs_energyplus_5,
    Data6=hbcontextsrfs_energyplus_3)  # -> flatten(Result)
toggle_3 = BooleanToggle(True)
toggle_4 = BooleanToggle(True)
toggle_5 = BooleanToggle(True)
groundsurfacereflectivities = Data(flatten(dup_2))
boundarypoints = Point(split.ListA)
analysispoints = Point(flatten(dispatch_2.ListA))
clean_2 = CleanTree(RemoveNulls=toggle_4, RemoveInvalid=toggle_4, RemoveEmpty=toggle_4, Tree=merge)
hbcontext = Data(flatten(clean_2))
toggle_6 = BooleanToggle(True)
runradiancefilegeneration = Boolean(toggle_6)
runeplusfilegeneration = Boolean(toggle_6)
skypatchdensity = Panel("0")

# ---- group: GROUND SURFACES
python_19 = GhPythonScript(Refresh=refreshall, MaterialPanel=material_6)  # -> LayerName, Roughness, Thickness, Conductivity, Density, SpecificHeat, ThermalAbsorptivity, SolarAbsorptivity, Porosity; inputs Refresh: Boolean, MaterialPanel: list; same code as python
cluster_42 = Cluster_3(solarabsorptivity=python_19.SolarAbsorptivity)
epopaquemat_13 = Honeybee_EnergyPlusOpaqueMaterial(
    name=python_19.LayerName,
    roughness=python_19.Roughness,
    thickness=python_19.Thickness,
    conductivity=python_19.Conductivity,
    density=python_19.Density,
    specificHeat=python_19.SpecificHeat,
    thermAbsp=python_19.ThermalAbsorptivity,
    solAbsp=python_19.SolarAbsorptivity,
    visAbsp=python_19.SolarAbsorptivity)  # -> EPMaterial; plug-in component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
cluster_43 = Cluster(toplayer=toplayer, layername=python_19.LayerName)  # -> surfaces_2, surfacenames_2
radopaquemat_13 = HoneybeePlus_RadianceOpaqueMaterial(name=graft(python_19.LayerName), reflect=graft(cluster_42), spec=0, rough=0)  # -> simplify(material); plug-in component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
epconstruction_13 = Honeybee_EnergyPlusConstruction(name=python_19.LayerName, layer_1=epopaquemat_13)  # -> EPConstruction; plug-in component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
cluster_44 = Cluster_2(surfaces=cluster_43.surfaces_2)
createhbsrfs_12 = Honeybee_createHBSrfs(geometry=cluster_43.surfaces_2, srfName=cluster_43.surfacenames_2, srfType="2", EPConstruction=epconstruction_13)  # -> readMe, simplify(flatten(HBSurface)); plug-in component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
hbsurface_19 = HoneybeePlus_HoneybeeSurface(geo=cluster_43.surfaces_2, names=cluster_43.surfacenames_2, type="2", rad_mat=radopaquemat_13)  # -> report, flatten(HB_srf); plug-in component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
hb_srfs_radiance_19 = Data(hbsurface_19.HB_srf)
boundaries_12 = Data(flatten(cluster_44))
reflectivity_12 = Data(cluster_42)

# ----
makeadiabatic = Honeybee_MakeAdiabatic(HBSrfs=createhbsrfs_12.HBSurface)  # -> HBSrfs; plug-in component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

# ---- group: GROUND SURFACES (continued)
hbsrfs_energyplus_12 = Data(makeadiabatic)

# ----
merge_2 = Merge(
    Data1=hbsrfs_energyplus_9,
    Data2=hbsrfs_energyplus_10,
    Data3=hbsrfs_energyplus_8,
    Data4=hbsrfs_energyplus_11,
    Data5=hbsrfs_energyplus_7,
    Data6=hbsrfs_energyplus_2,
    Data7=hbsrfs_energyplus_6,
    Data8=hbsrfs_energyplus_4,
    Data9=hbsrfs_energyplus_5,
    Data10=hbsrfs_energyplus_12,
    Data11=hbsrfs_energyplus_3,
    Data12=hbsrfs_energyplus)  # -> flatten(Result)
merge_3 = Merge(
    Data1=hb_srfs_radiance_17,
    Data2=hb_srfs_radiance_14,
    Data3=hb_srfs_radiance_15,
    Data4=hb_srfs_radiance_13,
    Data5=hb_srfs_radiance_18,
    Data6=hb_srfs_radiance_10,
    Data7=hb_srfs_radiance_2,
    Data8=hb_srfs_radiance_8,
    Data9=hb_srfs_radiance_4,
    Data10=hb_srfs_radiance_7,
    Data11=hb_srfs_radiance_19,
    Data12=hb_srfs_radiance_3,
    Data13=hb_srfs_radiance,
    Data14=hb_srfs_radiance_16,
    Data15=hb_srfs_radiance_11,
    Data16=hb_srfs_radiance_5,
    Data17=hb_srfs_radiance_6,
    Data18=hb_srfs_radiance_12,
    Data19=hb_srfs_radiance_9)  # -> flatten(Result)
clean_3 = CleanTree(RemoveNulls=toggle_3, RemoveInvalid=toggle_3, RemoveEmpty=toggle_3, Tree=merge_2)
clean_4 = CleanTree(RemoveNulls=toggle_5, RemoveInvalid=toggle_5, RemoveEmpty=toggle_5, Tree=merge_3)
createhbzones = Honeybee_createHBZones(name="GROUND_ZONE", HBSurfaces=flatten(clean_3), isConditioned=Toggle(False))  # -> readMe, HBZone; plug-in component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
hb_srfs = Data(flatten(clean_4))
hbzones = Data(flatten([createhbzones.HBZone, hbzones_energyplus]))

# ---- group: Generate EnergyPlus surface temperature model
toggle_7 = BooleanToggle(False)
simcontrol = Honeybee_SimulationControl(
    doZoneSizingCalculation=toggle_7,
    doSystemSizingCalculation=toggle_7,
    doPlantSizingCalculation=toggle_7,
    runSimForSizingPeriods=toggle_7,
    runSimForRunPeriods=Toggle(True))  # -> simControls; plug-in component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
importgroundtemp = Ladybug_ImportGroundTemp(epwFile=weatherfile)  # -> readMe, groundtemp1st, groundtemp2nd, groundtemp3rd, profileCrvs, crvColors, graphAxes, graphtext, Legend; plug-in component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
shadowpar = Honeybee_ShadowPar(calculationMethod="TimestepFrequency", frequency="1", maximumFigure="1000")  # -> shadowPar; plug-in component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
strnum = Ladybug_SeparateData(inputList=flatten(importgroundtemp.groundtemp1st))  # -> numbers, strings; plug-in component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
panel_2 = Panel("""OutputControl:Table:Style,Comma;
Output:Variable,*,Surface Outside Face Temperature, hourly;
Output:Diagnostics,DisplayExtraWarnings;""")
panel_3 = Panel("0")
energysimpar = Honeybee_EnergySimulationPar(
    timestep=6,
    shadowCalcPar=shadowpar,
    solarDistribution="3",
    simulationControls=simcontrol,
    terrain=panel_3,
    monthlyGrndTemps=strnum.numbers)  # -> energySimPar; plug-in component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
exporttoopenstudio = Honeybee_ExportToOpenStudio(
    epwWeatherFile=weatherfile,
    energySimPar=energysimpar,
    HBZones=flatten(hbzones),
    HBContext=flatten(hbcontext),
    simulationOutputs=flatten(panel_2),
    writeOSM=runeplusfilegeneration,
    runSimulation="3",
    fileName=toplayer,
    workingDir=output_directory)  # -> readMe, osmFileAddress, idfFileAddress, resultFileAddress, eioFileAddress, rddFileAddress, htmlReport, studyFolder, model; plug-in component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
createbat = GhPythonScript(epwPath=weatherfile, eplusPath=e_executable_path, idfPath=exporttoopenstudio.idfFileAddress)  # -> command
# ---------- createbat: Python ----------
import rhinoscriptsyntax as rs
import os, json

# Create EnergyPlus run command
#idf_path = os.path.join(_outputDir, _caseName, "OpenStudio", _caseName, "ModelToIdf", "in.idf").replace("\\", "/")
#idf_output_dir = os.path.join(_outputDir, _caseName, "OpenStudio", _caseName, "ModelToIdf").replace("\\", "/")
#eplus_output_path = os.path.join(_outputDir, _caseName, "OpenStudio", _caseName, "ModelToIdf", "eplusout.csv").replace("\\", "/")
#eplus_command = '"{0:}" -a -r -x -d "{3:}" -w "{1:}" "{2:}"'.format(_eplusPath.replace("\\", "/"), _epwFile, idf_path, idf_output_dir)

# Base path for batch file
bat_dir = os.path.dirname(os.path.dirname(os.path.dirname(os.path.dirname(_idfPath))))
_batPath = os.path.join(bat_dir, "run_eplus.bat")

# Output directory for eplus run
eplus_out_dir = os.path.dirname(_idfPath)

# Command string to write to BAT
eplus_command = '"{0:}" -a -r -x -d "{3:}" -w "{1:}" "{2:}"'.format(_eplusPath, _epwPath, _idfPath, eplus_out_dir).replace("\\", "/")

# Write BAT file
with open(_batPath, "w") as f:
    f.write(eplus_command)

command = eplus_command
# ---------- end createbat ----------

# ---- group: Generate Radiance sample point incident radiation model
wea = HoneybeePlus_WEAFromEPW(epw_file=weatherfile)  # -> wea; plug-in component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
analysisgrid = HoneybeePlus_AnalysisGrid(test_points=analysispoints)  # -> analysis_grid; plug-in component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
skymatrix = HoneybeePlus_SkyMatrix(north=0, wea=wea, density=1)  # -> skymtx; plug-in component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
annualdlrecipe = HoneybeePlus_AnnualDaylightRecipe(skymtx=skymatrix, analysis_grids=analysisgrid, analysis_type="1", reuse_dmtx=Toggle(True))  # -> analysis_recipe; plug-in component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
runradiance = HoneybeePlus_RunRadianceAnalysis(
    analysis_recipe=annualdlrecipe,
    HB_objects=flatten(hb_srfs),
    folder=output_directory,
    name=toplayer,
    write=runradiancefilegeneration)  # -> report, outputs; plug-in component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
createbat_2 = GhPythonScript(HB_report=runradiance.report)  # -> command; inputs HB_report: list
# ---------- createbat_2: Python ----------
import os

# Base path for batch file
base_path = os.path.dirname(HB_report[3].replace("Writing recipe contents to: ", ""))
_batPath = os.path.join(base_path, "run_radiance.bat")
ref_bat_path = os.path.join(base_path, "gridbased_annual", "commands.bat")

# Write BAT file
with open(_batPath, "w") as f:
    f.write(ref_bat_path)

command = ref_bat_path
# ---------- end createbat_2 ----------

# ----
logicpause = GhPythonScript(x=createbat, y=createbat_2)  # -> a, b
# ---------- logicpause: Python ----------
a = 1
b = "Verdana"
# ---------- end logicpause ----------

# ---- group: TESTING GROUP FOR DODGY GEOMETRY!
# TEST SPACE FOR
# DODGY GROUND
# GEOMETRY
panel_4 = Panel("AverageOverDaysInFrequency")  # disabled
panel_5 = Panel("365")  # disabled
panel_6 = Panel("200")  # disabled
shadowpar_2 = Honeybee_ShadowPar(calculationMethod=panel_4, frequency=panel_5, maximumFigure=panel_6)  # -> shadowPar; disabled; plug-in component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
panel_7 = Panel("Output:Diagnostics,DisplayExtraWarnings;")  # disabled
panel_8 = Panel("0")  # disabled
energysimpar_2 = Honeybee_EnergySimulationPar(
    timestep=6,
    shadowCalcPar=shadowpar_2,
    solarDistribution=panel_8,
    simulationControls=simcontrol,
    terrain=panel_3,
    monthlyGrndTemps=strnum.numbers)  # -> energySimPar; disabled; plug-in component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
panel_9 = Panel("5")  # disabled
toggle_8 = BooleanToggle(True)  # disabled
panel_10 = Panel("19")  # disabled
panel_11 = Panel("12")  # disabled
analysisperiod = Ladybug_AnalysisPeriod(fromMonth=panel_9, fromDay=panel_11, toMonth=panel_9, toDay=panel_10)  # -> readMe, analysisPeriod; disabled; plug-in component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
exporttoopenstudio_2 = Honeybee_ExportToOpenStudio(
    epwWeatherFile=weatherfile,
    analysisPeriod=analysisperiod.analysisPeriod,
    energySimPar=energysimpar_2,
    HBZones=flatten(hbzones),
    HBContext=flatten(hbcontext),
    simulationOutputs=flatten(panel_2),
    additionalStrings=flatten(panel_7),
    writeOSM=toggle_8,
    runSimulation=toggle_8)  # -> readMe, osmFileAddress, idfFileAddress, resultFileAddress, eioFileAddress, rddFileAddress, htmlReport, studyFolder, model; disabled; plug-in component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
readepsrfresult = Honeybee_ReadEPSurfaceResult(resultFileAddress=exporttoopenstudio_2.resultFileAddress)  # -> port, surfaceOutdoorTemp, port_2, port_3, port_4, port_5, port_6, port_7, port_8; disabled; plug-in component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
panel_12 = Panel("8959")  # disabled
partition = PartitionList(List=flatten(readepsrfresult.surfaceOutdoorTemp), Size=panel_12)  # -> simplify(Chunks); disabled
viewer = ParamViewer(partition)  # disabled

# ---- group: Calculate point/surface view factors
hbzones_2 = Data(hbzones)
labelzones = Honeybee_LabelZones(HBZones=flatten(hbzones_2), attribute="name", font=logicpause.b)  # -> zoneTxtLabels, labelBasePts, brepTxtLabels, zoneWireFrames; plug-in component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
tsort = SortText(Keys=labelzones.zoneTxtLabels, Values=hbzones_2, Culture=127)  # -> Keys, Values
debrep_2 = DeconstructBrep(Brep=tsort.Values)  # -> flatten(Faces), Edges, Vertices
srfviewfactors = Ladybug_SurfaceViewAnalysis(
    testPtsOrPlanes=flatten(analysispoints),
    testSrfs=debrep_2.Faces,
    context=hbcontext,
    viewResolution=skypatchdensity,
    parallel=Toggle(True),
    runIt=Toggle(True))  # -> readMe, srfViewFactors, viewVecSrfIndex, viewVectors, viewPatches, viewPatchBasePt; plug-in component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
lng_5 = ListLength(List=debrep_2.Faces)
split_2 = SplitList(List=srfviewfactors.srfViewFactors, Index=lng_5)  # -> simplify(ListA), simplify(ListB)
shading_surface_view_factors = Data(split_2.ListB)
surface_view_factors = Data(split_2.ListA)

# ---- group: Calculate point/sky view-factors
shadingmask = Ladybug_ShadingMask(centerPtOrPlane=analysispoints, context=hbcontext, scale=logicpause.a)  # -> contextMask, orientationMask, strategyMask, skyMask, port, contextExposure, orientExposure, strategyExposure, skyExposure; plug-in component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
ptskyexposure = Data(shadingmask.skyExposure)

# ----
createbat_recipe = GhPythonScript(
    epwFile=weatherfile,
    outputDir=output_directory,
    caseName=toplayer,
    samplePoints=analysispoints,
    boundaryPoints=boundarypoints,
    groundReflectivities=groundsurfacereflectivities,
    skyViewFactors=ptskyexposure,
    srfViewFactors=surface_view_factors)  # inputs samplePoints: list of Point3d, boundaryPoints: list of Point3d, groundReflectivities: list, skyViewFactors: list, srfViewFactors: tree
# ---------- createbat_recipe: Python ----------
__author__ = "tgerrish"
__version__ = "2020.03.17"

import rhinoscriptsyntax as rs
import os, json

# Copy epw file to local directory
os.system('copy {0:} {1:}'.format(_epwFile, os.path.join(_outputDir, _caseName, os.path.basename(_epwFile))))

# Define Radiance result directory
radiance_result_directory = os.path.join(_outputDir, _caseName, "gridbased_annual", "result").replace("\\", "/")

# Generate the JSON recipe for processing in pure Python
d = {}

# EPW file
d["epw"] = os.path.join(_outputDir, _caseName, os.path.basename(_epwFile)).replace("\\", "/")

# Add surface view factors
d["surface_view_factors"] = [[j for j in _srfViewFactors.Branch(i)] for i in range(_srfViewFactors.BranchCount)]

# Add sky view factors
d["sky_view_factors"] = _skyViewFactors

# Add ground reflectivieis
d["ground_reflectivities"] = _groundReflectivities

# Path to radiance results
d["radiation_results"] = radiance_result_directory

# XYZ locations
d["points"] = [[i.X, i.Y, i.Z] for i in _samplePoints]

# Boundary points
d["boundary"] = [[i.X, i.Y, i.Z] for i in _boundaryPoints]

# Energyplus surface temperatures
d["eplus_results"] = os.path.join(_outputDir, _caseName, "OpenStudio", _caseName, "ModelToIdf", "eplusout.csv").replace("\\", "/")

# Output recipe
if (len(_skyViewFactors) != 0) & (_srfViewFactors.BranchCount != 0):
    output_path = os.path.join(_outputDir, _caseName, "recipe.json").replace("\\", "/")
    with open(output_path, "w") as f:
        json.dump(d, f)
# ---------- end createbat_recipe ----------

# ==== cluster Cluster
layername = ClusterInput()
toplayer = ClusterInput()
layername_2 = Data(layername)
toplayer_2 = Data(toplayer)
concat = Concatenate(FragmentA=toplayer_2, FragmentC="::", FragmentB=layername_2)
dpipeline = DynamicGeometryPipeline(
    LayerFilter=concat,
    TypeFilter="Brep",
    NameFilter="*",
    GroupByLayer=False,
    GroupByType=False,
    IncludeHidden=True,
    IncludeLocked=True,
    enableFullPath=True,
    listenToAttributes=True)  # -> simplify(flatten(GeometryOut))
debrep = DeconstructBrep(Brep=dpipeline)  # -> flatten(Faces), Edges, Vertices
lng = ListLength(List=debrep.Faces)
series = Series(Start=0, Step=1, Count=lng)
concat_2 = Concatenate(FragmentA=layername_2, FragmentB=series)
surfacenames = Data(concat_2)
surfaces = Surface(debrep.Faces)
surfacenames_2 = ClusterOutput(surfacenames)
surfaces_2 = ClusterOutput(surfaces)

# ==== cluster Cluster_2
surfaces = ClusterInput()
surfaces_2 = Surface(surfaces)
project = Project(Geometry=surfaces_2, Plane=PlaneXY(0, 0, 0))  # -> Geometry, Transform
area = Area(Geometry=project.Geometry)  # -> Area, Centroid
smaller = SmallerThan(FirstNumber=area.Area, SecondNumber="0.0001")  # -> SmallerThan, OrEqualTo
dispatch = Dispatch(List=surfaces_2, DispatchPattern=smaller.SmallerThan)  # -> ListA, ListB
edges = BrepEdges(Brep=dispatch.ListB)  # -> Naked, Interior, NonManifold
join = JoinCurves(Curves=edges.Naked, Preserve=False)
explode = Explode(Curve=join, Recursive=True)  # -> Segments, simplify(Vertices)
shift = ShiftList(List=explode.Vertices, Shift=1, Wrap=False)
short = ShortestList(ListA=explode.Vertices, ListB=shift, TrimMode=2)  # -> ListA, ListB
item = ListItem(List=short.ListA, Index=0, Wrap=True)  # -> Item, Item1
item_2 = ListItem(List=short.ListB, Index=0, Wrap=True)  # -> Item, Item1
vec2pt = Vector2Pt(PointA=item.Item, PointB=item_2.Item, Unitize=False)  # -> Vector, Length
vec2pt_2 = Vector2Pt(PointA=item.Item1, PointB=item_2.Item1, Unitize=False)  # -> Vector, Length
Z = UnitZ(Factor=1)
xprod = CrossProduct(VectorA=vec2pt.Vector, VectorB=vec2pt_2.Vector, Unitize=False)  # -> Vector, Length
cset = CreateSet(List=explode.Vertices)  # -> Set, Map
dprod = DotProduct(VectorA=xprod.Vector, VectorB=Z, Unitize=True)
larger = LargerThan(FirstNumber=dprod, SecondNumber=0)  # -> LargerThan, OrEqualTo
rev = ReverseList(List=cset.Set)
cull = CullPattern(List=rev, CullPattern=invert(larger.LargerThan))
cull_2 = CullPattern(List=cset.Set, CullPattern=larger.LargerThan)
merge = Merge(Data1=cull_2, Data2=cull)
pline = PolyLine(Vertices=merge, Closed=Toggle(True))
boundaries = Data(flatten(pline))
boundaries_2 = ClusterOutput(boundaries)

# ==== cluster Cluster_3
solarabsorptivity = ClusterInput()
solarabsorptivity_2 = Data(solarabsorptivity)
subtraction = Subtraction(A="1", B=solarabsorptivity_2)
reflectivity = Data(subtraction)
reflectivity_2 = ClusterOutput(reflectivity)

# ==== cluster Cluster_4
layername = ClusterInput()
toplayer = ClusterInput()
layername_2 = Data(layername)
toplayer_2 = Data(toplayer)
concat = Concatenate(FragmentA=toplayer_2, FragmentC="::", FragmentB=layername_2)
dpipeline = DynamicGeometryPipeline(
    LayerFilter=concat,
    TypeFilter="Brep",
    NameFilter="*",
    GroupByLayer=False,
    GroupByType=False,
    IncludeHidden=True,
    IncludeLocked=True,
    enableFullPath=True,
    listenToAttributes=True)  # -> simplify(flatten(GeometryOut))
lng = ListLength(List=dpipeline)
series = Series(Start=0, Step=1, Count=lng)
concat_2 = Concatenate(FragmentA=layername_2, FragmentB=series)
brepnames = Data(concat_2)
brep = Brep(dpipeline)
brepnames_2 = ClusterOutput(brepnames)
brep_2 = ClusterOutput(brep)
